# Grasshopper definition kit_of_parts.gh (Grasshopper 1.0.7)
# plug-ins: Human

number_slider = Slider(70, range=0..70)

brep = Brep(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)
brep_2 = Brep(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)
brep_3 = Brep(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)
brep_4 = Brep([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])

brep_5 = Brep(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)
brep_6 = Brep([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])
brep_7 = Brep(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)

brep_8 = Brep(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)
brep_9 = Brep([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])
brep_10 = Brep([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])
brep_11 = Brep([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])

mesh_brep = MeshBrep(
    Brep=brep_2,
    Settings={GridMaxCount=0, GridMinCount=16, JaggedSeams=False, MaxEdgeLength=0, MinEdgeLength=0.0001, MinTolerance=0, Refine=True, RefineAngle=0, RelativeTolerance=0.65, SimplePlanes=True, Tolerance=0})
mesh_brep_2 = MeshBrep(
    Brep=brep_3,
    Settings={GridMaxCount=0, GridMinCount=16, JaggedSeams=False, MaxEdgeLength=0, MinEdgeLength=0.0001, MinTolerance=0, Refine=True, RefineAngle=0, RelativeTolerance=0.65, SimplePlanes=True, Tolerance=0})
simple_mesh = SimpleMesh(Brep=brep_4)
mesh_brep_3 = MeshBrep(
    Brep=brep,
    Settings={GridMaxCount=0, GridMinCount=16, JaggedSeams=False, MaxEdgeLength=0, MinEdgeLength=0.0001, MinTolerance=0, Refine=True, RefineAngle=0, RelativeTolerance=0.65, SimplePlanes=True, Tolerance=0})

mesh_brep_4 = MeshBrep(
    Brep=brep_8,
    Settings={GridMaxCount=0, GridMinCount=16, JaggedSeams=False, MaxEdgeLength=0, MinEdgeLength=0.0001, MinTolerance=0, Refine=True, RefineAngle=0, RelativeTolerance=0.65, SimplePlanes=True, Tolerance=0})
simple_mesh_2 = SimpleMesh(Brep=brep_9)
mesh_brep_5 = MeshBrep(
    Brep=brep_11,
    Settings={GridMaxCount=0, GridMinCount=16, JaggedSeams=False, MaxEdgeLength=0, MinEdgeLength=0.0001, MinTolerance=0, Refine=True, RefineAngle=0, RelativeTolerance=0.65, SimplePlanes=True, Tolerance=0})
simple_mesh_3 = SimpleMesh(Brep=brep_10)
mesh_brep_6 = MeshBrep(
    Brep=brep_6,
    Settings={GridMaxCount=0, GridMinCount=16, JaggedSeams=False, MaxEdgeLength=0, MinEdgeLength=0.0001, MinTolerance=0, Refine=True, RefineAngle=0, RelativeTolerance=0.65, SimplePlanes=True, Tolerance=0})
mesh_brep_7 = MeshBrep(
    Brep=brep_7,
    Settings={GridMaxCount=0, GridMinCount=16, JaggedSeams=False, MaxEdgeLength=0, MinEdgeLength=0.0001, MinTolerance=0, Refine=True, RefineAngle=0, RelativeTolerance=0.65, SimplePlanes=True, Tolerance=0})
mesh_brep_8 = MeshBrep(
    Brep=brep_5,
    Settings={GridMaxCount=0, GridMinCount=16, JaggedSeams=False, MaxEdgeLength=0, MinEdgeLength=0.0001, MinTolerance=0, Refine=True, RefineAngle=0, RelativeTolerance=0.65, SimplePlanes=True, Tolerance=0})
mesh_join = MeshJoin(Meshes=simple_mesh_3)
mesh_join_2 = MeshJoin(Meshes=mesh_brep_5)
mesh_join_3 = MeshJoin(Meshes=[mesh_brep_3, mesh_brep])
mesh_join_4 = MeshJoin(Meshes=simple_mesh_2)
# Stair Landing
geometry = Geometry(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)
# Staircase
geometry_2 = Geometry(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)
# Corridor1
geometry_3 = Geometry(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)
point = Point(Point(1017.769881, -48.84277816, 1050))
curve = Curve(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)
point_2 = Point([Point(17.7698805, 951.1572218, 1050), Point(1017.769881, 1951.157222, 1050), Point(2017.769881, 951.1572218, 1050)])
curve_2 = Curve([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])
boolean_toggle = BooleanToggle(True)
point_3 = Point([Point(17.7698805, -1048.842778, 1050), Point(-3982.230119, -1048.842778, 1050)])
curve_3 = Curve([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])
point_4 = Point([Point(-2632.230119, 2017.938584, 5835.738409), Point(-2632.230119, 2017.938584, -150)])
curve_4 = Curve([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])
# Corridor2
geometry_4 = Geometry(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)
boolean_toggle_2 = BooleanToggle(True)
boolean_toggle_3 = BooleanToggle(True)
point_5 = Point([Point(17.7698805, 951.1572218, 1050), Point(17.7698805, 3084.719946, 4350)])
curve_5 = Curve([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])
point_6 = Point([Point(17.7698805, -1048.842778, 1050), Point(1017.769881, -48.84277816, 1050), Point(2017.769881, -1048.842778, 1050), Point(1017.769881, -2048.842778, 1050)])
curve_6 = Curve([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])
point_list = PointList(Points=point_5, Size=number_slider)
point_list_2 = PointList(Points=point, Size=number_slider)
point_list_3 = PointList(Points=point_2, Size=number_slider)
point_list_4 = PointList(Points=point_6, Size=number_slider)
point_list_5 = PointList(Points=point_3, Size=number_slider)
conndir = Wasp_ConnectionFromDirection(GEO=geometry_2, CEN=point_4, UP=curve_4, T="top")  # -> CONN, PLN_OUT; inputs CEN: list of Point3d, UP: list of Curve, T: list; plug-in component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
conndir_2 = Wasp_ConnectionFromDirection(GEO=geometry_2, CEN=point_5, UP=curve_5, T="front")  # -> CONN, PLN_OUT; inputs CEN: list of Point3d, UP: list of Curve, T: list; plug-in component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
conndir_3 = Wasp_ConnectionFromDirection(GEO=geometry, CEN=point, UP=curve, T="1")  # -> CONN, PLN_OUT; inputs CEN: list of Point3d, UP: list of Curve, T: list; plug-in component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
conndir_4 = Wasp_ConnectionFromDirection(GEO=geometry, CEN=point_2, UP=curve_2, T="0")  # -> CONN, PLN_OUT; inputs CEN: list of Point3d, UP: list of Curve, T: list; plug-in component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
attribute = Wasp_Attribute(ID="railing", VAL=mesh_join_3, TR=boolean_toggle)  # -> ATTR; inputs VAL: list, TR: Boolean; plug-in component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
attribute_2 = Wasp_Attribute(ID="beam", VAL=mesh_brep_2, TR=boolean_toggle)  # -> ATTR; inputs VAL: list, TR: Boolean; plug-in component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
attribute_3 = Wasp_Attribute(ID="wood", VAL=mesh_brep_6, TR=boolean_toggle_2)  # -> ATTR; inputs VAL: list, TR: Boolean; plug-in component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
attribute_4 = Wasp_Attribute(ID="floor", VAL=mesh_brep_8, TR=boolean_toggle_2)  # -> ATTR; inputs VAL: list, TR: Boolean; plug-in component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
attribute_5 = Wasp_Attribute(ID="columns", VAL=mesh_brep_7, TR=boolean_toggle_2)  # -> ATTR; inputs VAL: list, TR: Boolean; plug-in component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
attribute_6 = Wasp_Attribute(ID="wood", VAL=mesh_join_4, TR=boolean_toggle_3)  # -> ATTR; inputs VAL: list, TR: Boolean; plug-in component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
attribute_7 = Wasp_Attribute(ID="stair", VAL=simple_mesh, TR=boolean_toggle)  # -> ATTR; inputs VAL: list, TR: Boolean; plug-in component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
conndir_5 = Wasp_ConnectionFromDirection(GEO=geometry_3, CEN=point_6, UP=curve_6, T="0")  # -> CONN, PLN_OUT; inputs CEN: list of Point3d, UP: list of Curve, T: list; plug-in component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
attribute_8 = Wasp_Attribute(ID="floor", VAL=mesh_brep_4, TR=boolean_toggle_3)  # -> ATTR; inputs VAL: list, TR: Boolean; plug-in component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
conndir_6 = Wasp_ConnectionFromDirection(GEO=geometry_4, CEN=point_3, UP=curve_3, T="0")  # -> CONN, PLN_OUT; inputs CEN: list of Point3d, UP: list of Curve, T: list; plug-in component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
attribute_9 = Wasp_Attribute(ID="wood", VAL=mesh_join, TR=boolean_toggle_3)  # -> ATTR; inputs VAL: list, TR: Boolean; plug-in component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
attribute_10 = Wasp_Attribute(ID="floor", VAL=mesh_join_2, TR=boolean_toggle_3)  # -> ATTR; inputs VAL: list, TR: Boolean; plug-in component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
advpart = Wasp_AdvancedPart(NAME="stairs", GEO=geometry_2, CONN=flatten(conndir_2.CONN), ATTR=[attribute, attribute_2, attribute_7])  # -> PART; inputs GEO: Mesh, CONN: list, HI: list, ATTR: list, SUP: list, AEC: list, OC: list; plug-in component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
advpart_2 = Wasp_AdvancedPart(
    NAME="landing",
    GEO=geometry,
    CONN=flatten([conndir_4.CONN, conndir_3.CONN]),
    ATTR=[attribute_4, attribute_3, attribute_5])  # -> PART; inputs GEO: Mesh, CONN: list, HI: list, ATTR: list, SUP: list, AEC: list, OC: list; plug-in component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
advpart_3 = Wasp_AdvancedPart(NAME="corridor-s", GEO=geometry_3, CONN=flatten(conndir_5.CONN), ATTR=[attribute_8, attribute_6])  # -> PART; inputs GEO: Mesh, CONN: list, HI: list, ATTR: list, SUP: list, AEC: list, OC: list; plug-in component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
advpart_4 = Wasp_AdvancedPart(NAME="corridor-l", GEO=geometry_4, CONN=flatten(conndir_6.CONN), ATTR=[attribute_10, attribute_9])  # -> PART; inputs GEO: Mesh, CONN: list, HI: list, ATTR: list, SUP: list, AEC: list, OC: list; plug-in component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
merge = Merge(Data1=advpart, Data2=advpart_2, Data3=advpart_3, Data4=advpart_4)
rulegen = Wasp_RulesGenerator(PART=merge)  # -> R; inputs PART: list, SELF_P: Boolean, SELF_C: Boolean, TYP: Boolean, GR: list; plug-in component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
number_of_parts = GetInteger(Slider(100, range=0..100), AtLeast=1, AtMost=1, Maximum=2147483647, Minimum=-2147483648)
seed = GetInteger(Slider(100, range=0..100), AtLeast=1, AtMost=1, Maximum=2147483647, Minimum=-2147483648)
reset = GetBoolean(Button(), AtLeast=1, AtMost=1, FalseValue="False", TrueValue="True")
stochasticaggregation = Wasp_StochasticAggregation(PART=flatten(merge), N=number_of_parts, RULES=rulegen, SEED=seed, RESET=reset)  # -> AGGR, PART_OUT; inputs PART: list, PREV: list, N: Int32, RULES: list, SEED: Int32, MODE: Int32, GC: list, RESET: Boolean; plug-in component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
namefilter = Wasp_FilterPartsByName(PART=stochasticaggregation.PART_OUT, NAME="stairs")  # -> PART_OUT, MASK; inputs PART: list, NAME: list; plug-in component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
namefilter_2 = Wasp_FilterPartsByName(PART=stochasticaggregation.PART_OUT, NAME="landing")  # -> PART_OUT, MASK; inputs PART: list, NAME: list; plug-in component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
namefilter_3 = Wasp_FilterPartsByName(PART=stochasticaggregation.PART_OUT, NAME="corridor-l")  # -> PART_OUT, MASK; inputs PART: list, NAME: list; plug-in component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
namefilter_4 = Wasp_FilterPartsByName(PART=stochasticaggregation.PART_OUT, NAME="corridor-s")  # -> PART_OUT, MASK; inputs PART: list, NAME: list; plug-in component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
value_list = ValueList({"block": 0, "railing": 1, "beam": 2, "stair": 3}, selected="block")
getattr = Wasp_GetAttributeByName(PART=namefilter_2.PART_OUT, ID="columns")  # -> VAL; plug-in component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
partgeo = Wasp_GetPartGeometry(PART=namefilter.PART_OUT)  # -> GEO; plug-in component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
partgeo_2 = Wasp_GetPartGeometry(PART=namefilter_2.PART_OUT)  # -> GEO; plug-in component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
partgeo_3 = Wasp_GetPartGeometry(PART=namefilter_4.PART_OUT)  # -> GEO; plug-in component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
partgeo_4 = Wasp_GetPartGeometry(PART=namefilter_3.PART_OUT)  # -> GEO; plug-in component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
getattr_2 = Wasp_GetAttributeByName(PART=namefilter.PART_OUT, ID="stair")  # -> VAL; plug-in component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
getattr_3 = Wasp_GetAttributeByName(PART=namefilter.PART_OUT, ID="beam")  # -> VAL; plug-in component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
getattr_4 = Wasp_GetAttributeByName(PART=namefilter.PART_OUT, ID="railing")  # -> VAL; plug-in component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
getattr_5 = Wasp_GetAttributeByName(PART=namefilter_2.PART_OUT, ID="wood")  # -> VAL; plug-in component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
getattr_6 = Wasp_GetAttributeByName(PART=namefilter_2.PART_OUT, ID="floor")  # -> VAL; plug-in component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
getattr_7 = Wasp_GetAttributeByName(PART=namefilter_4.PART_OUT, ID="wood")  # -> VAL; plug-in component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
getattr_8 = Wasp_GetAttributeByName(PART=namefilter_4.PART_OUT, ID="floor")  # -> VAL; plug-in component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
getattr_9 = Wasp_GetAttributeByName(PART=namefilter_3.PART_OUT, ID="wood")  # -> VAL; plug-in component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
getattr_10 = Wasp_GetAttributeByName(PART=namefilter_3.PART_OUT, ID="floor")  # -> VAL; plug-in component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
stream_filter = StreamFilter(Gate=value_list, Stream0=partgeo, Stream1=getattr_4, Stream2=getattr_3, Stream3=getattr_2)
mesh_edges = MeshEdges(Mesh=stream_filter)  # -> NakedEdges, InteriorEdges, NonManifoldEdges
custom_preview = CustomPreview(Geometry=getattr, Material=ColourSwatch(SwatchColor=RGB(130, 141, 148)))
custom_preview_2 = CustomPreview(Geometry=getattr_2, Material=ColourSwatch(SwatchColor=RGB(148, 88, 35)))
custom_preview_3 = CustomPreview(Geometry=getattr_3, Material=ColourSwatch(SwatchColor=RGB(143, 143, 143)))
custom_preview_4 = CustomPreview(Geometry=getattr_4, Material=ColourSwatch(SwatchColor=RGB(12, 194, 240)))
custom_preview_5 = CustomPreview(Geometry=getattr_5, Material=ColourSwatch(SwatchColor=RGB(148, 88, 35)))
custom_preview_6 = CustomPreview(Geometry=getattr_6, Material=ColourSwatch(SwatchColor=RGB(107, 107, 107)))
custom_preview_7 = CustomPreview(Geometry=partgeo_2, Material=ColourSwatch(SwatchColor=RGB(240, 118, 12)))
custom_preview_8 = CustomPreview(Geometry=getattr_7, Material=ColourSwatch(SwatchColor=RGB(148, 88, 35)))
custom_preview_9 = CustomPreview(Geometry=getattr_8, Material=ColourSwatch(SwatchColor=RGB(107, 107, 107)))
custom_preview_10 = CustomPreview(Geometry=partgeo_3, Material=ColourSwatch(SwatchColor=RGB(113, 255, 5)))
custom_preview_11 = CustomPreview(Geometry=getattr_9, Material=ColourSwatch(SwatchColor=RGB(148, 88, 35)))
custom_preview_12 = CustomPreview(Geometry=getattr_10, Material=ColourSwatch(SwatchColor=RGB(107, 107, 107)))
custom_preview_13 = CustomPreview(Geometry=partgeo_4, Material=ColourSwatch(SwatchColor=RGB(38, 153, 20)))
custom_preview_lineweights = CustomPreviewLineweights(
    Geometry=mesh_edges.InteriorEdges,
    Shader=ColourSwatch(SwatchColor=RGB(0, 0, 0)),
    Thickness=Slider(3, range=0..10),
    Absolute=False)

# ---- group: RH_OUT:railing
geometry_5 = Geometry(getattr_4)

# ---- group: RH_OUT: stairs
geometry_6 = Geometry(getattr_2)

# ---- group: RH_OUT:beam
geometry_7 = Geometry(getattr_3)

# ---- group: RH_OUT: columns
geometry_8 = Geometry(getattr)

# ---- group: RH_OUT:floor
geometry_9 = Geometry([getattr_6, getattr_8, getattr_10])

# ---- group: RH_OUT:wood
geometry_10 = Geometry([getattr_5, getattr_7, getattr_9])
